# Grasshopper definition convert_building_physics.gh (Grasshopper 0.9.76)
# plug-ins: Python Interpreter, Py2Gh, FalseStartToggle

# ---- group: Starting date (simulation day)
number_of_hours = Panel("138")
run_radiation = FalseStartToggle(False)
start_month = Panel("2")
start_day = Panel("1")

# ---- group: building physics
# Export Attributes and Results
supply_systems = PythonScript()  # -> out
# ---------- supply_systems: Python ----------
"""
This script is adapted from building_physics.py in RC_BuildingSimulator.
Refer to the python file for variable and parameter definitions
"""

__authors__ = "Prageeth Jayathissa, Justin Zarb"
__copyright__ = "Copyright 2016, Architecture and Building Systems - ETH Zurich"
__credits__ = ["Gabriel Happle, Justin Zarb, Michael Fehr"]
__license__ = "MIT"
__version__ = "0.1"
__maintainer__ = "Prageeth Jayathissa"
__email__ = "jayathissa@arch.ethz.ch"
__status__ = "BETA"


import scriptcontext

class Building(object):
    '''Sets the parameters of the building. '''

    def __init__(self,
                 window_area=4.0,
                 external_envelope_area=15.0, #external wall area + window area
                 room_depth=7.0,
                 room_width=5.0,
                 room_height=3.0,
                 lighting_load=11.7,
                 lighting_control=300.0,
                 lighting_utilisation_factor=0.45,
                 lighting_maintenance_factor=0.9,
                 u_walls=0.2,
                 u_windows=1.1,
                 ach_vent=1.5,
                 ach_infl=0.5,
                 ventilation_efficiency=0.6,
                 thermal_capacitance_per_floor_area=165000,
                 t_set_heating=20.0,
                 t_set_cooling=26.0,
                 max_cooling_energy_per_floor_area=-float("inf"),
                 max_heating_energy_per_floor_area=float("inf"),
                 heating_supply_system=scriptcontext.sticky["OilBoilerNew"],  
                 cooling_supply_system=scriptcontext.sticky["HeatPumpAir"],
                 heating_emission_system=scriptcontext.sticky["OldRadiators"],
                 cooling_emission_system=scriptcontext.sticky["AirConditioning"],
                 ):

        # Building Dimensions
        self.window_area = window_area  # [m2] Window Area
        self.room_depth = room_depth  # [m] Room Depth
        self.room_width = room_width  # [m] Room Width
        self.room_height = room_height  # [m] Room Height

        # Fenestration and Lighting Properties
        self.lighting_load = lighting_load  # [kW/m2] lighting load
        self.lighting_control = lighting_control  # [lux] Lighting set point
        # How the light entering the window is transmitted to the working plane
        self.lighting_utilisation_factor = lighting_utilisation_factor
        # How dirty the window is. Section 2.2.3.1 Environmental Science
        # Handbook
        self.lighting_maintenance_factor = lighting_maintenance_factor

        # Calculated Properties
        self.floor_area = room_depth * room_width  # [m2] Floor Area
        # [m2] Effective Mass Area assuming a medium weight building #12.3.1.2
        self.mass_area = self.floor_area * 2.5
        self.room_vol = room_width * room_depth * \
            room_height  # [m3] Room Volume
        self.total_internal_area = self.floor_area * 2 + \
            room_width * room_height * 2 + room_depth * room_height * 2
        # TODO: Standard doesn't explain what A_t is. Needs to be checked
        self.A_t = self.total_internal_area

        # Single Capacitance  5 conductance Model Parameters
        # [kWh/K] Room Capacitance. Default based on ISO standard 12.3.1.2 for medium heavy buildings
        self.c_m = thermal_capacitance_per_floor_area * self.floor_area
        # Conductance of opaque surfaces to exterior [W/K]
        self.h_tr_em = u_walls * (external_envelope_area - window_area)
        # Conductance to exterior through glazed surfaces [W/K], based on
        # U-wert of 1W/m2K
        self.h_tr_w = u_windows * window_area

        # Determine the ventilation conductance
        ach_tot = ach_infl + ach_vent  # Total Air Changes Per Hour
        # temperature adjustment factor taking ventilation and infiltration
        # [ISO: E -27]
        b_ek = (1 - (ach_vent / (ach_tot)) * ventilation_efficiency)
        self.h_ve_adj = 1200 * b_ek * self.room_vol * \
            (ach_tot / 3600)  # Conductance through ventilation [W/M]
        # transmittance from the internal air to the thermal mass of the
        # building
        self.h_tr_ms = 9.1 * self.mass_area
        # Conductance from the conditioned air to interior building surface
        self.h_tr_is = self.total_internal_area * 3.45

        # Thermal set points
        self.t_set_heating = t_set_heating
        self.t_set_cooling = t_set_cooling

        # Thermal Properties
        self.has_heating_demand = False  # Boolean for if heating is required
        self.has_cooling_demand = False  # Boolean for if cooling is required
        self.max_cooling_energy = max_cooling_energy_per_floor_area * \
            self.floor_area  # max cooling load (W/m2)
        self.max_heating_energy = max_heating_energy_per_floor_area * \
            self.floor_area  # max heating load (W/m2)

        # Building System Properties
        self.heating_supply_system = heating_supply_system
        self.cooling_supply_system = cooling_supply_system
        self.heating_emission_system = heating_emission_system
        self.cooling_emission_system = cooling_emission_system

    def solve_building_lighting(self, illuminance, occupancy):
        """
        Calculates the lighting demand for a set timestep

        :param illuminance: Illuminance transmitted through the window [Lumens]
        :type illuminance: float
        :param occupancy: Probability of full occupancy
        :type occupancy: float

        :return: self.lighting_demand, Lighting Energy Required for the timestep
        :rtype: float

        """
        # Cite: Environmental Science Handbook, SV Szokolay, Section 2.2.1.3
        # also, this might be sped up by pre-calculating the constants, but idk. first check with profiler...
        lux = (illuminance * self.lighting_utilisation_factor *
               self.lighting_maintenance_factor) / self.floor_area  # [Lux]

        if lux < self.lighting_control and occupancy > 0:
            # Lighting demand for the hour
            self.lighting_demand = self.lighting_load * self.floor_area
        else:
            self.lighting_demand = 0

    def solve_building_energy(self, internal_gains, solar_gains, t_out, t_m_prev):
        """
        Calculates the heating and cooling consumption of a building for a set timestep

        :param internal_gains: internal heat gains from people and appliances [W]
        :type internal_gains: float
        :param solar_gains: solar heat gains [W]
        :type solar_gains: float
        :param t_out: Outdoor air temperature [C]
        :type t_out: float
        :param t_m_prev: Previous air temperature [C]
        :type t_m_prev: float

        :return: self.heating_demand, space heating demand of the building
        :return: self.heating_sys_electricity, heating electricity consumption
        :return: self.heating_sys_fossils, heating fossil fuel consumption 
        :return: self.cooling_demand, space cooling demand of the building
        :return: self.cooling_sys_electricity, electricity consumption from cooling
        :return: self.cooling_sys_fossils, fossil fuel consumption from cooling
        :return: self.electricity_out, electricity produced from combined heat pump systems
        :return: self.sys_total_energy, total exergy consumed (electricity + fossils) for heating and cooling
        :return: self.heating_energy, total exergy consumed (electricity + fossils) for heating 
        :return: self.cooling_energy, total exergy consumed (electricity + fossils) for cooling
        :return: self.cop, Coefficient of Performance of the heating or cooling system
        :rtype: float

        """
        # Main File

        # Calculate the heat transfer definitions for formula simplification
        self.calc_h_tr_1()
        self.calc_h_tr_2()
        self.calc_h_tr_3()

        # check demand, and change state of self.has_heating_demand, and self._has_cooling_demand
        self.has_demand(internal_gains, solar_gains, t_out, t_m_prev)

        if not self.has_heating_demand and not self.has_cooling_demand:

            # no heating or cooling demand
            # calculate temperatures of building R-C-model and exit
            # --> rc_model_function_1(...)
            self.energy_demand = 0

            # y u no pep8 bra?
            self.heating_demand = 0  # Energy required by the zone
            self.cooling_demand = 0  # Energy surplus of the zone
            # Energy (in electricity) required by the supply system to provide
            # HeatingDemand
            self.heating_sys_electricity = 0
            # Energy (in fossil fuel) required by the supply system to provide
            # HeatingDemand
            self.heating_sys_fossils = 0
            # Energy (in electricity) required by the supply system to get rid
            # of CoolingDemand
            self.cooling_sys_electricity = 0
            # Energy (in fossil fuel) required by the supply system to get rid
            # of CoolingDemand
            self.cooling_sys_fossils = 0
            # Electricity produced by the supply system (e.g. CHP)
            self.electricity_out = 0

        else:

            # has heating/cooling demand

            # Calculates energy_demand used below
            self.calc_energy_demand(
                internal_gains, solar_gains, t_out, t_m_prev)

            self.calc_temperatures_crank_nicolson(
                self.energy_demand, internal_gains, solar_gains, t_out, t_m_prev)
            # calculates the actual t_m resulting from the actual heating
            # demand (energy_demand)

            # Calculate the Heating/Cooling Input Energy Required

            supply_director = scriptcontext.sticky["SupplyDirector"]()  # Initialise Heating System Manager

            if self.has_heating_demand:
                supply_director.set_builder(self.heating_supply_system(load=self.energy_demand, 
                                                                t_out=t_out, 
                                                                heating_supply_temperature=self.heating_supply_temperature,
                                                                cooling_supply_temperature=self.cooling_supply_temperature, 
                                                                has_heating_demand=self.has_heating_demand, 
                                                                has_cooling_demand=self.has_cooling_demand))
                supplyOut = supply_director.calc_system()
                # All Variables explained underneath line 467
                self.heating_demand = self.energy_demand
                self.heating_sys_electricity = supplyOut.electricity_in
                self.heating_sys_fossils = supplyOut.fossils_in
                self.cooling_demand = 0
                self.cooling_sys_electricity = 0
                self.cooling_sys_fossils = 0
                self.electricity_out = supplyOut.electricity_out

            elif self.has_cooling_demand:
                supply_director.set_builder(self.cooling_supply_system(load=self.energy_demand * (-1), 
                                                                t_out=t_out, 
                                                                heating_supply_temperature=self.heating_supply_temperature,
                                                                cooling_supply_temperature=self.cooling_supply_temperature, 
                                                                has_heating_demand=self.has_heating_demand, 
                                                                has_cooling_demand=self.has_cooling_demand))
                supplyOut = supply_director.calc_system()
                self.heating_demand = 0
                self.heating_sys_electricity = 0
                self.heating_sys_fossils = 0
                self.cooling_demand = self.energy_demand
                self.cooling_sys_electricity = supplyOut.electricity_in
                self.cooling_sys_fossils = supplyOut.fossils_in
                self.electricity_out = supplyOut.electricity_out

            self.cop = supplyOut.cop

        self.sys_total_energy = self.heating_sys_electricity + self.heating_sys_fossils + \
            self.cooling_sys_electricity + self.cooling_sys_fossils
        self.heating_energy = self.heating_sys_electricity + self.heating_sys_fossils
        self.cooling_energy = self.cooling_sys_electricity + self.cooling_sys_fossils

    # TODO: rename. this is expected to return a boolean. instead, it changes state??? you don't want to change state...
    # why not just return has_heating_demand and has_cooling_demand?? then call the function "check_demand"
    # has_heating_demand, has_cooling_demand = self.check_demand(...)
    def has_demand(self, internal_gains, solar_gains, t_out, t_m_prev):
        """
        Determines whether the building requires heating or cooling
        Used in: solve_building_energy()

        # step 1 in section C.4.2 in [C.3 ISO 13790]
        """

        # set energy demand to 0 and see if temperatures are within the comfort
        # range
        energy_demand = 0
        # Solve for the internal temperature t_Air
        self.calc_temperatures_crank_nicolson(
            energy_demand, internal_gains, solar_gains, t_out, t_m_prev)

        # If the air temperature is less or greater than the set temperature,
        # there is a heating/cooling load
        if self.t_air < self.t_set_heating:
            self.has_heating_demand = True
            self.has_cooling_demand = False
        elif self.t_air > self.t_set_cooling:
            self.has_cooling_demand = True
            self.has_heating_demand = False
        else:
            self.has_heating_demand = False
            self.has_cooling_demand = False

    def calc_temperatures_crank_nicolson(self, energy_demand, internal_gains, solar_gains, t_out, t_m_prev):
        """
        Determines node temperatures and computes derivation to determine the new node temperatures
        Used in: has_demand(), solve_building_energy(), calc_energy_demand()
        # section C.3 in [C.3 ISO 13790]
        """

        self.calc_heat_flow(t_out, internal_gains, solar_gains, energy_demand)

        self.calc_phi_m_tot(t_out)

        # calculates the new bulk temperature POINT from the old one
        self.calc_t_m_next(t_m_prev)

        # calculates the AVERAGE bulk temperature used for the remaining
        # calculation
        self.calc_t_m(t_m_prev)

        self.calc_t_s(t_out)

        self.calc_t_air(t_out)

        self.calc_t_opperative()

        return self.t_m, self.t_air, self.t_opperative

    def calc_energy_demand(self, internal_gains, solar_gains, t_out, t_m_prev):
        """
        Calculates the energy demand of the space if heating/cooling is active
        Used in: solve_building_energy()
        # Step 1 - Step 4 in Section C.4.2 in [C.3 ISO 13790]
        """

        # Step 1: Check if heating or cooling is needed 
        #(Not needed, but doing so for readability when comparing with the standard)
        # Set heating/cooling to 0
        energy_demand_0 = 0
        # Calculate the air temperature with no heating/cooling
        t_air_0 = self.calc_temperatures_crank_nicolson(
            energy_demand_0, internal_gains, solar_gains, t_out, t_m_prev)[1]

        # Step 2: Calculate the unrestricted heating/cooling required

        # determine if we need heating or cooling based based on the condition
        # that no heating or cooling is required
        if self.has_heating_demand:
            t_air_set = self.t_set_heating
        elif self.has_cooling_demand:
            t_air_set = self.t_set_cooling
        else:
            raise NameError(
                'heating function has been called even though no heating is required')

        # Set a heating case where the heating load is 10x the floor area (10
        # W/m2)
        energy_floorAx10 = 10 * self.floor_area

        # Calculate the air temperature obtained by having this 10 W/m2
        # setpoint
        t_air_10 = self.calc_temperatures_crank_nicolson(
            energy_floorAx10, internal_gains, solar_gains, t_out, t_m_prev)[1]

        # Determine the unrestricted heating/cooling off the building
        self.calc_energy_demand_unrestricted(
            energy_floorAx10, t_air_set, t_air_0, t_air_10)

        # Step 3: Check if available heating or cooling power is sufficient
        if self.max_cooling_energy <= self.energy_demand_unrestricted <= self.max_heating_energy:

            self.energy_demand = self.energy_demand_unrestricted
            self.t_air_ac = t_air_set  # not sure what this is used for at this stage TODO

        # Step 4: if not sufficient then set the heating/cooling setting to the
        # maximum
        # necessary heating power exceeds maximum available power
        elif self.energy_demand_unrestricted > self.max_heating_energy:

            self.energy_demand = self.max_heating_energy

        # necessary cooling power exceeds maximum available power
        elif self.energy_demand_unrestricted < self.max_cooling_energy:

            self.energy_demand = self.max_cooling_energy

        else:
            self.energy_demand = 0
            raise ValueError('unknown radiative heating/cooling system status')

        # calculate system temperatures for Step 3/Step 4
        self.calc_temperatures_crank_nicolson(
            self.energy_demand, internal_gains, solar_gains, t_out, t_m_prev)

    def calc_energy_demand_unrestricted(self, energy_floorAx10, t_air_set, t_air_0, t_air_10):
        """
        Calculates the energy demand of the system if it has no maximum output restrictions
        # (C.13) in [C.3 ISO 13790]


        Based on the Thales Intercept Theorem. 
        Where we set a heating case that is 10x the floor area and determine the temperature as a result 
        Assuming that the relation is linear, one can draw a right angle triangle. 
        From this we can determine the heating level required to achieve the set point temperature
        This assumes a perfect HVAC control system
        """
        self.energy_demand_unrestricted = energy_floorAx10 * \
            (t_air_set - t_air_0) / (t_air_10 - t_air_0)

    def calc_heat_flow(self, t_out, internal_gains, solar_gains, energy_demand):
        """
        Calculates the heat flow from the solar gains, heating/cooling system, and internal gains into the building

        The input of the building is split into the air node, surface node, and thermal mass node based on
        on the following equations

        #C.1 - C.3 in [C.3 ISO 13790]

        Note that this equation has diverged slightly from the standard 
        as the heating/cooling node can enter any node depending on the
        emission system selected

        """

        # Calculates the heat flows to various points of the building based on the breakdown in section C.2, formulas C.1-C.3
        # Heat flow to the air node
        self.phi_ia = 0.5 * internal_gains
        # Heat flow to the surface node
        self.phi_st = (1 - (self.mass_area / self.A_t) - (self.h_tr_w /
                            (9.1 * self.A_t))) * (0.5 * internal_gains + solar_gains)
        # Heatflow to the thermal mass node
        self.phi_m = (self.mass_area / self.A_t) * \
            (0.5 * internal_gains + solar_gains)

        # We call the EmissionDirector to modify these flows depending on the
        # system and the energy demand
        emDirector = scriptcontext.sticky["EmissionDirector"]()
        # Set the emission system to the type specified by the user
        emDirector.set_builder(self.heating_emission_system(
            energy_demand=energy_demand))
        # Calculate the new flows to each node based on the heating system
        flows = emDirector.calc_flows()

        # Set modified flows to building object
        self.phi_ia += flows.phi_ia_plus
        self.phi_st += flows.phi_st_plus
        self.phi_m += flows.phi_m_plus

        # Set supply temperature to building object
        # TODO: This currently is constant for all emission systems, to be
        # modified in the future
        self.heating_supply_temperature = flows.heating_supply_temperature
        self.cooling_supply_temperature = flows.cooling_supply_temperature

    def calc_t_m_next(self, t_m_prev):
        """
        Primary Equation, calculates the temperature of the next time step
        # (C.4) in [C.3 ISO 13790]
        """

        self.t_m_next = ((t_m_prev * ((self.c_m / 3600.0) - 0.5 * (self.h_tr_3 + self.h_tr_em))) +
                         self.phi_m_tot) / ((self.c_m / 3600.0) + 0.5 * (self.h_tr_3 + self.h_tr_em))

    def calc_phi_m_tot(self, t_out):
        """
        Calculates a global heat transfer. This is a definition used to simplify equation
        calc_t_m_next so it's not so long to write out
        # (C.5) in [C.3 ISO 13790]
        # h_ve = h_ve_adj and t_supply = t_out [9.3.2 ISO 13790]
        """

        t_supply = t_out  # ASSUMPTION: Supply air comes straight from the outside air

        self.phi_m_tot = self.phi_m + self.h_tr_em * t_out + \
            self.h_tr_3 * (self.phi_st + self.h_tr_w * t_out + self.h_tr_1 *
                           ((self.phi_ia / self.h_ve_adj) + t_supply)) / self.h_tr_2

    def calc_h_tr_1(self):
        """
        Definition to simplify calc_phi_m_tot
        # (C.6) in [C.3 ISO 13790]

        """
        self.h_tr_1 = 1.0 / (1.0 / self.h_ve_adj + 1.0 / self.h_tr_is)

    def calc_h_tr_2(self):
        """
        Definition to simplify calc_phi_m_tot
        # (C.7) in [C.3 ISO 13790]

        """

        self.h_tr_2 = self.h_tr_1 + self.h_tr_w

    def calc_h_tr_3(self):
        """
        Definition to simplify calc_phi_m_tot
        # (C.8) in [C.3 ISO 13790]

        """

        self.h_tr_3 = 1.0 / (1.0 / self.h_tr_2 + 1.0 / self.h_tr_ms)


    def calc_t_m(self, t_m_prev):
        """
        Temperature used for the calculations, average between newly calculated and previous bulk temperature
        # (C.9) in [C.3 ISO 13790]
        """
        self.t_m = (self.t_m_next + t_m_prev) / 2.0

    def calc_t_s(self, t_out):
        """
        Calculate the temperature of the inside room surfaces
        # (C.10) in [C.3 ISO 13790]
        # h_ve = h_ve_adj and t_supply = t_out [9.3.2 ISO 13790]
        """

        t_supply = t_out  # ASSUMPTION: Supply air comes straight from the outside air

        self.t_s = (self.h_tr_ms * self.t_m + self.phi_st + self.h_tr_w * t_out + self.h_tr_1 * \
            (t_supply + self.phi_ia / self.h_ve_adj)) / \
            (self.h_tr_ms + self.h_tr_w + self.h_tr_1)

    def calc_t_air(self, t_out):
        """
        Calculate the temperature of the air node
        # (C.11) in [C.3 ISO 13790]
        # h_ve = h_ve_adj and t_supply = t_out [9.3.2 ISO 13790]
        """

        t_supply = t_out

        # Calculate the temperature of the inside air
        self.t_air = (self.h_tr_is * self.t_s + self.h_ve_adj *
                      t_supply + self.phi_ia) / (self.h_tr_is + self.h_ve_adj)

    def calc_t_opperative(self):
        """
        The opperative temperature is a weighted average of the air and mean radiant temperatures. 
        It is not used in any further calculation at this stage
        # (C.12) in [C.3 ISO 13790]
        """

        self.t_opperative = 0.3 * self.t_air + 0.7 * self.t_s

scriptcontext.sticky["RC_Zone"] = Building
# ---------- end supply_systems ----------

# ----
emission_systems = PythonScript()  # -> out
# ---------- emission_systems: Python ----------
import scriptcontext


class EmissionDirector:

    """
    The director sets what Emission system is being used, and runs that set Emission system
    """

    builder = None

    # Sets what Emission system is used
    def set_builder(self, builder):
        #        self.__builder = builder
        self.builder = builder
    # Calcs the energy load of that system. This is the main() fu

    def calc_flows(self):

        # Director asks the builder to produce the system body. self.builder
        # is an instance of the class

        body = self.builder.heat_flows()

        return body


class EmissionSystemBase:

    """ 
    The base class in which systems are built from
    """

    def __init__(self, energy_demand):

        self.energy_demand = energy_demand


    def heat_flows(self): pass
    """
    determines the node where the heating/cooling system is active based on the system used
    Also determines the return and supply temperatures for the heating/cooling system
    """


class OldRadiators(EmissionSystemBase):
    """
    Old building with radiators and high supply temperature
    Heat is emitted to the air node
    """

    def heat_flows(self):
        flows = Flows()
        flows.phi_ia_plus = self.energy_demand
        flows.phi_st_plus = 0
        flows.phi_m_plus = 0

        flows.heating_supply_temperature = 65
        flows.heating_return_temperature = 45
        flows.cooling_supply_temperature = 12
        flows.cooling_return_temperature = 21

        return flows


class NewRadiators(EmissionSystemBase):
    """    
    Newer building with radiators and medium supply temperature
    Heat is emitted to the air node
    """

    def heat_flows(self):
        flows = Flows()
        flows.phi_ia_plus = self.energy_demand
        flows.phi_st_plus = 0
        flows.phi_m_plus = 0

        flows.heating_supply_temperature = 50
        flows.heating_return_temperature = 35
        flows.cooling_supply_temperature = 12
        flows.cooling_return_temperature = 21

        return flows

class ChilledBeams(EmissionSystemBase):
    """
    Chilled beams: identical to newRadiators but used for cooling
    Heat is emitted to the air node
    """

    def heat_flows(self):
        flows = Flows()
        flows.phi_ia_plus = self.energy_demand
        flows.phi_st_plus = 0
        flows.phi_m_plus = 0

        flows.heating_supply_temperature = 50
        flows.heating_return_temperature = 35
        flows.cooling_supply_temperature = 18
        flows.cooling_return_temperature = 21

        return flows


class AirConditioning(EmissionSystemBase):
    """
    All heat is given to the air via an AC-unit. HC input via the air node as in the ISO 13790 Annex C.
    supplyTemperature as with new radiators (assumption)
    Heat is emitted to the air node
    """

    def heat_flows(self):
        flows = Flows()
        flows.phi_ia_plus = self.energy_demand
        flows.phi_st_plus = 0
        flows.phi_m_plus = 0

        flows.heating_supply_temperature = 40
        flows.heating_return_temperature = 20
        flows.cooling_supply_temperature = 6
        flows.cooling_return_temperature = 15

        return flows

class FloorHeating(EmissionSystemBase):
    """
    All HC energy goes into the surface node, supplyTemperature low
    Heat is emitted to the surface node
    """

    def heat_flows(self):
        flows = Flows()
        flows.phi_ia_plus = 0
        flows.phi_st_plus = self.energy_demand
        flows.phi_m_plus = 0

        flows.heating_supply_temperature = 40
        flows.heating_return_temperature = 5
        flows.cooling_supply_temperature = 12
        flows.cooling_return_temperature = 21

        return flows

class TABS(EmissionSystemBase):
    """
    Thermally activated Building systems. HC energy input into bulk node. Supply Temperature low.
    Heat is emitted to the thermal mass node
    """

    def heat_flows(self):
        flows = Flows()
        flows.phi_ia_plus = 0
        flows.phi_st_plus = 0
        flows.phi_m_plus = self.energy_demand

        flows.heating_supply_temperature = 50
        flows.heating_return_temperature = 35
        flows.cooling_supply_temperature = 12
        flows.cooling_return_temperature = 21

        return flows


class Flows:
    """
    A base object to store output variables
    """

    phi_ia_plus = float("nan")
    phi_m_plus = float("nan")
    phi_st_plus = float("nan")

    heating_supply_temperature = float("nan")
    cooling_supply_temperature = float("nan")
    # return temperatures

scriptcontext.sticky["EmissionDirector"] = EmissionDirector
scriptcontext.sticky["OldRadiators"] = OldRadiators
scriptcontext.sticky["AirConditioning"] = AirConditioning
# ---------- end emission_systems ----------
supply_systems_2 = PythonScript()  # -> out
# ---------- supply_systems_2: Python ----------
import scriptcontext

"""
Supply System Parameters for Heating and Cooling

Model of different Supply systems. New Supply Systems can be introduced by adding new classes

TODO: Have a look at CEA calculation methodology 
https://github.com/architecture-building-systems/CEAforArcGIS/blob/master/cea/technologies/heatpumps.py
"""


__author__ = "Prageeth Jayathissa, Michael Fehr"
__copyright__ = "Copyright 2016, Architecture and Building Systems - ETH Zurich"
__credits__ = [""]
__license__ = "MIT"
__version__ = "0.1"
__maintainer__ = "Prageeth Jayathissa"
__email__ = "jayathissa@arch.ethz.ch"
__status__ = "BETA"


# This is one layer of abstraction too many, however it is kept for future explansion of the supply system
class SupplyDirector:

    """
    The director sets what Supply system is being used, and runs that set Supply system
    """

    builder = None

    # Sets what building system is used
    def set_builder(self, builder):
        self.builder = builder

    # Calcs the energy load of that system. This is the main() function
    def calc_system(self):

        # Director asks the builder to produce the system body. self.builder
        # is an instance of the class

        body = self.builder.calc_loads()

        return body


class SupplySystemBase:

    """
     The base class in which Supply systems are built from 
    """

    def __init__(self, load, t_out, heating_supply_temperature, cooling_supply_temperature, has_heating_demand, has_cooling_demand):
        self.load = load  # Energy Demand of the building at that time step
        self.t_out = t_out  # Outdoor Air Temperature
        # Temperature required by the emission system
        self.heating_supply_temperature = heating_supply_temperature
        self.cooling_supply_temperature = cooling_supply_temperature
        self.has_heating_demand = has_heating_demand
        self.has_cooling_demand = has_cooling_demand

    def calc_loads(self): pass
    """
    Caculates the electricty / fossil fuel consumption of the set supply system
    If the system also generates electricity, then this is stored as electricity_out
    """


class OilBoilerOld(SupplySystemBase):
    """
    Old oil boiler with fuel efficiency of 63 percent (medium of range in report of semester project M. Fehr)
    No condensation, pilot light
    """

    def calc_loads(self):
        system = SupplyOut()
        system.fossils_in = self.load / 0.63
        system.electricity_in = 0
        system.electricity_out = 0
        return system


class OilBoilerMed(SupplySystemBase):
    """
    Classic oil boiler with fuel efficiency of 82 percent (medium of range in report of semester project M. Fehr)
    No condensation, but better nozzles etc.
    """

    def calc_loads(self):
        system = SupplyOut()
        system.fossils_in = self.load / 0.82
        system.electricity_in = 0
        system.electricity_out = 0
        return system


class OilBoilerNew(SupplySystemBase):
    """
    New oil boiler with fuel efficiency of 98 percent (value from report of semester project M. Fehr)
    Condensation boiler, latest generation
    """

    def calc_loads(self):
        system = SupplyOut()
        system.fossils_in = self.load / 0.98
        system.electricity_in = 0
        system.electricity_out = 0
        return system


class HeatPumpAir(SupplySystemBase):
    """
    BETA Version
    Air-Water heat pump. Outside Temperature as reservoir temperature.
    COP based off regression analysis of manufacturers data
    Source: "A review of domestic heat pumps, Iain Staffell, Dan Brett, Nigel Brandonc and Adam Hawkes"
    http://pubs.rsc.org/en/content/articlepdf/2012/ee/c2ee22653g

    TODO: Validate this methodology
    """

    def calc_loads(self):
        system = SupplyOut()

        if self.has_heating_demand:
            # determine the temperature difference, if negative, set to 0
            deltaT = max(0, self.heating_supply_temperature - self.t_out)
            # Eq (4) in Staggell et al.
            system.cop = 6.81 - 0.121 * deltaT + 0.000630 * deltaT**2
            system.electricity_in = self.load / system.cop

        elif self.has_cooling_demand:
            # determine the temperature difference, if negative, set to 0
            deltaT = max(0, self.t_out - self.cooling_supply_temperature)
            # Eq (4) in Staggell et al.
            system.cop = 6.81 - 0.121 * deltaT + 0.000630 * deltaT**2
            system.electricity_in = self.load / system.cop

        else:
            raise ValueError(
                'HeatPumpAir called although there is no heating/cooling demand')

        system.fossils_in = 0
        system.electricity_out = 0
        return system


class HeatPumpWater(SupplySystemBase):
    """"
    BETA Version
    Reservoir temperatures 7 degC (winter) and 12 degC (summer).
    Ground-Water heat pump. Outside Temperature as reservoir temperature.
    COP based off regression analysis of manufacturers data
    Source: "A review of domestic heat pumps, Iain Staffell, Dan Brett, Nigel Brandonc and Adam Hawkes"
    http://pubs.rsc.org/en/content/articlepdf/2012/ee/c2ee22653g

        # TODO: Validate this methodology
    """


    def calc_loads(self):
        system = SupplyOut()
        if self.has_heating_demand:
            deltaT = max(0, self.heating_supply_temperature - 7.0)
            # Eq (4) in Staggell et al.
            system.cop = 8.77 - 0.150 * deltaT + 0.000734 * deltaT**2
            system.electricity_in = self.load / system.cop

        elif self.has_cooling_demand:
            deltaT = max(0, 12.0 - self.cooling_supply_temperature)
            # Eq (4) in Staggell et al.
            system.cop = 8.77 - 0.150 * deltaT + 0.000734 * deltaT**2
            system.electricity_in = self.load / system.cop

        system.fossils_in = 0
        system.electricity_out = 0
        return system


class ElectricHeating(SupplySystemBase):
    """
    Straight forward electric heating. 100 percent conversion to heat.
    """

    def calc_loads(self):
        system = SupplyOut()
        system.electricity_in = self.load
        system.fossils_in = 0
        system.electricity_out = 0
        return system


class CHP(SupplySystemBase):
    """
    Combined heat and power unit with 60 percent thermal and 33 percent
    electrical fuel conversion. 93 percent overall
    """

    def calc_loads(self):
        system = SupplyOut()
        system.fossils_in = self.load / 0.6
        system.electricity_in = 0
        system.electricity_out = system.fossils_in * 0.33
        return system


class DirectHeater(SupplySystemBase):
    """
    Created by PJ to check accuracy against previous simulation
    """

    def calc_loads(self):
        system = SupplyOut()
        system.electricity_in = self.load
        system.fossils_in = 0
        system.electricity_out = 0
        return system


class DirectCooler(SupplySystemBase):
    """
    Created by PJ to check accuracy against previous simulation
    """

    def calc_loads(self):
        system = SupplyOut()
        system.electricity_in = self.load
        system.fossils_in = 0
        system.electricity_out = 0
        return system


class SupplyOut:
    """
    The System class which is used to output the final results
    """
    fossils_in = float("nan")
    electricity_in = float("nan")
    electricity_out = float("nan")
    cop = float("nan")


scriptcontext.sticky["SupplyDirector"] = SupplyDirector
scriptcontext.sticky["OilBoilerNew"] = OilBoilerNew
scriptcontext.sticky["HeatPumpAir"] = HeatPumpAir
# ---------- end supply_systems_2 ----------
# Draw a room with windows
panel = Panel("4.9")
building_physics = BuildingPhysics()
# Get temperatures and calculate radiation using ladybug
outward_facing_surfaces = Panel("0")
ladybug = Ladybug_Ladybug()  # -> Vviiiiiiiiiizzz; plug-in component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
box = DomainBox(Base=PlaneXY(0, 0, 0), X=panel, Y="7", Z="3.1")
debrep = DeconstructBrep(Brep=box)  # -> Faces, Edges, Vertices
open_weather_file = Ladybug_OpenEPWWeatherFile(open=Toggle(True))  # -> epwFile; plug-in component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

# ---- group: display
cull_i = CullIndex(List=debrep.Faces, Indices=outward_facing_surfaces, Wrap=True)
cluster = Cluster(G=debrep.Faces, L=debrep.Faces)  # -> orientedtocam, int_2
tag = TextTag3D(Location=cluster.orientedtocam, Text=cluster.int_2, Size=0.4, Justification=7)

# ----
item = ListItem(List=debrep.Faces, Index=outward_facing_surfaces, Wrap=True)
importepw = Ladybug_ImportEpw(epwFile=open_weather_file)  # -> readMe, latitude, location, dryBulbTemperature, dewPointTemperature, relativeHumidity, windSpeed, windDirection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; plug-in component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
gencumulativeskymtx = Ladybug_GenCumulativeSkyMtx(epwFile=open_weather_file, skyDensity=0, useOldRes=True, runIt=Toggle(True))  # -> readMe, cumulativeSkyMtx; plug-in component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
window_wall_ratio = Slider(0.9, range=0..1)
edges = BrepEdges(Brep=item)  # -> simplify(Naked), Interior, NonManifold
join = JoinCurves(Curves=edges.Naked, Preserve=False)
area = Area(Geometry=join)  # -> simplify(Area), Centroid
scale = Scale(Geometry=join, Center=area.Centroid, Factor=window_wall_ratio)  # -> flatten(Geometry), Transform
area_2 = Area(Geometry=scale.Geometry)  # -> Area, Centroid
legendpar = Ladybug_LegendParameters(highBound=3000)  # -> legendPar; plug-in component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
ma = MassAddition(Input=area_2.Area)  # -> Result, PartialResults
cooling_sp = Panel("26")
start_month_2 = Panel("18")
srfsplit = SurfaceSplit(Surface=item, Curves=scale.Geometry)
total_window_area = Panel(ma.Result)
cdd_hdd = Ladybug_CDD_HDD(
    hourlyDryBulbTemperature=importepw.dryBulbTemperature,
    coolingBaseTemperature=cooling_sp,
    heatingBaseTemperature=start_month_2)  # -> readMe, daily_coolingDegDays, daily_heatingDegDays, monthly_coolingDegDays, monthly_heatingDegDays, annual_coolingDegDays, annual_heatingDegDays; plug-in component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
walls = ListItem(List=srfsplit, Index=0, Wrap=True)  # -> flatten(Item)
walls_2 = ListItem(List=srfsplit, Index=1, Wrap=True)  # -> flatten(Item)

# ---- group: External envelope area
area_3 = Area(Geometry=flatten([walls, walls_2]))  # -> Area, Centroid
ma_2 = MassAddition(Input=area_3.Area)  # -> Result, PartialResults

# ----
window_area = Area(Geometry=walls_2)  # -> Area, Centroid

# ----
# Create Zone
number_slider = Slider(1.5, range=0..1.5)
simulate_period = ASRCBuildingSimulator(
    window_area=window_area.Area,
    external_envelope_area=ma_2.Result,
    room_depth="7",
    room_width=panel,
    room_height="3.1",
    g_windows="0.6",
    ach_vent=number_slider,
    ach_infl=Slider(0.3, range=0..0.6))  # -> out, Zone, local_and_global_variables
# ---------- simulate_period: Python ----------
import Grasshopper.Kernel as gh
import scriptcontext

#  Initialize default values if no input is detected
zone_attributes = ['window_area','external_envelope_area','room_depth',
                  'room_width', 'room_height','lighting_load','lighting_control',
                  'lighting_utilisation_factor',  'lighting_maintenance_factor',
                  'u_walls', 'u_windows', 'ach_vent', 'ach_infl',
                  'ventilation_efficiency','thermal_capacitance_per_floor_area',
                  't_set_heating', 't_set_cooling', 'max_cooling_energy_per_floor_area',
                  'max_heating_energy_per_floor_area', 'heating_supply_system',  
                  'cooling_supply_system', 'heating_emission_system',
                  'cooling_emission_system']

initial_values = ['4.0','15.0','7.0','5.0','3.0','11.7','300.0','0.455','0.9',
                  '0.2','1.1','1.5','0.5','0.6','165000','20.0','26.0',
                  '-float("inf")','float("inf")','scriptcontext.sticky["OilBoilerNew"]',
                  'scriptcontext.sticky["HeatPumpAir"]', 'scriptcontext.sticky["OldRadiators"]',
                  'scriptcontext.sticky["AirConditioning"]']

local_and_global_variables = ['Key:Value']


for a,v in zip(zone_attributes,initial_values):
    exec('print %s'%a)
    if a is not None:
        pass
    else:
        exec('%s = %s'%(a,a))
    if 'supply' not in a and 'emission' not in a:
        local_and_global_variables.append(a+':'+v)
    elif 'supply' in a:
        local_and_global_variables.append(a+': supply_system.'+v[22:-2])
    elif 'emission' in a:
        local_and_global_variables.append(a+': emission_system.'+v[22:-2])

for v in local_and_global_variables:
    print v

#Initialise zone object
Zone = scriptcontext.sticky["RC_Zone"](
    window_area=window_area,
    external_envelope_area=external_envelope_area,
    room_depth=room_depth,
    room_width=room_width,
    room_height=room_height,
    lighting_load=lighting_load,
    lighting_control=lighting_control,
    ach_vent=ach_vent,
    ach_infl=ach_infl,
    thermal_capacitance_per_floor_area=thermal_capacitance_per_floor_area)

#for k in Zone.__dict__.keys():
#    print k


#  Export obect attributes for testing and debugging
attrs = vars(Zone)
for item in attrs.items():
    local_and_global_variables.append("%s: %s" % item)
# ---------- end simulate_period ----------

strnum = Ladybug_SeparateData(inputList=flatten(cdd_hdd.monthly_coolingDegDays))  # -> numbers, strings; plug-in component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
strnum_2 = Ladybug_SeparateData(inputList=flatten(cdd_hdd.monthly_heatingDegDays))  # -> numbers, strings; plug-in component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
panel_2 = Panel(simulate_period.local_and_global_variables)
cdd = Panel(strnum.numbers)
# Lighting data
title = Panel("indoor_air_temperature")
title_2 = Panel("outdoor_air_temperature")
title_3 = Panel("occupancy")
title_4 = Panel("ill")
# Energy data
title_5 = Panel("HOY")
title_6 = Panel("solar_gains")
title_7 = Panel("heating_demand")
title_8 = Panel("cooling_demand")
title_9 = Panel("lighting_demand")
# Temperature data
title_10 = Panel("HOY")
title_11 = Panel("internal_gains")
hdd = Panel(strnum_2.numbers)
radiation = Panel("hoy")
radiation_2 = Panel("radiation")
radiation_3 = Panel("internal_gains")
panel_3 = Panel("C:\Users\Zghiru\Documents\GitHub\RC_BuildingSimulator\rc_simulator\grasshopper_component\tests\grasshopper_result_energy.csv")  # disabled
panel_4 = Panel("C:\Users\Zghiru\Documents\GitHub\RC_BuildingSimulator\rc_simulator\grasshopper_component\tests\grasshopper_result_temperatures.csv")  # disabled
panel_5 = Panel("C:\Users\Zghiru\Documents\GitHub\RC_BuildingSimulator\rc_simulator\grasshopper_component\tests\grasshopper_result_lighting.csv")  # disabled

# ---- group: Simulate 1 hour
# Calculate 1 time step
number_slider_2 = Slider(22, range=-15..30)
buildingsimulator = ASRCBuildingSimulator(
    Zone=simulate_period.Zone,
    outdoor_air_temperature=Slider(20, range=-15..30),
    previous_mass_temperature=number_slider_2,
    internal_gains=Slider(10, range=0..2000),
    solar_irradiation=Slider(2000, range=0..2000),
    occupancy=Slider(0.1, range=0..1))  # -> out, indoor_air_temperature, lighting_demand, heating_demand, cooling_demand, energy_demand
# ---------- buildingsimulator: Python ----------
""" Not sure exactly but I think this should go here...
ghenv.Component.Name = "A/S RC Building Simulator"
ghenv.Component.NickName = 'buildingSimulator'
ghenv.Component.Message = 'VER 0.0.1'
ghenv.Component.IconDisplayMode = ghenv.Component.IconDisplayMode.application
#ghenv.Component.Category = "Ladybug"
#ghenv.Component.SubCategory = "3 | EnvironmentalAnalysis"
"""

import Grasshopper.Kernel as gh
import scriptcontext

# Initialise parameters

if outdoor_air_temperature == None:
    warning = "outdoor_air_temperature not specified. Assumed to be 10C"
    w = gh.GH_RuntimeMessageLevel.Warning
    ghenv.Component.AddRuntimeMessage(w, warning)
    t_air = 10
else:
    t_air = outdoor_air_temperature
    
if previous_mass_temperature == None:
    warning = "previous_mass_temperature not specified. Assumed to be 20C"
    w = gh.GH_RuntimeMessageLevel.Warning
    ghenv.Component.AddRuntimeMessage(w, warning)
    t_m_prev = 22
else:
    t_m_prev = previous_mass_temperature

if internal_gains == None:
    warning = "internal_gains not specified. Assumed to be 10W"
    w = gh.GH_RuntimeMessageLevel.Warning
    ghenv.Component.AddRuntimeMessage(w, warning)
    internal_gains = 10  # Watts

if solar_irradiation == None:
    warning = "solar_irradiation not specified. Assumed to be 2000W"
    w = gh.GH_RuntimeMessageLevel.Warning
    ghenv.Component.AddRuntimeMessage(w, warning)
    solar_irradiation = 2000 # Watts. Requires adjustment to account for window losses

if illuminance == None:
    warning = "illuminance not specified. Assumed to be 44000W"
    w = gh.GH_RuntimeMessageLevel.Warning
    ghenv.Component.AddRuntimeMessage(w, warning)
    ill = 44000  # Illuminance after transmitting through the window [Lumens]

if occupancy == None:
    warning = "Occupancy assumed to be 0.1"
    w = gh.GH_RuntimeMessageLevel.Warning
    ghenv.Component.AddRuntimeMessage(w, warning)
    occupancy = 0.1  # Occupancy for the timestep [people/hour/square_meter]

if Zone == None:
    Zone = scriptcontext.sticky["RC_Zone"]()
    warning = """No zone definition has been detected. The default zone will be
    applied."""
    w = gh.GH_RuntimeMessageLevel.Warning
    ghenv.Component.AddRuntimeMessage(w, warning)
else:
    Zone = Zone

#For now assume glass solar transmittance = 0.6
solar_gains = solar_irradiation * 0.6

Zone.solve_building_energy(internal_gains, solar_gains, t_air, t_m_prev)
Zone.solve_building_lighting(ill, occupancy)

indoor_air_temperature = Zone.t_air
mass_temperature = Zone.t_m  # Printing Room Temperature of the medium
lighting_demand =  Zone.lighting_demand  # Print Lighting Demand
energy_demand = Zone.energy_demand  # Print heating/cooling loads
heating_demand = Zone.heating_demand
cooling_demand = Zone.cooling_demand
# ---------- end buildingsimulator ----------
panel_6 = Panel(buildingsimulator.indoor_air_temperature)
panel_7 = Panel(buildingsimulator.lighting_demand)
panel_8 = Panel(buildingsimulator.heating_demand)
panel_9 = Panel(buildingsimulator.cooling_demand)

# ----
sunpath = Ladybug_SunPath(
    location=importepw.location,
    hour=12,
    day=start_day,
    month=start_month,
    timeStep=1,
    sunPathScale=0.1,
    dailyOrAnnualSunPath=True)  # -> readMe, sunVectors, sunAltitudes, sunAzimuths, port, sunSpheresMesh, sunPathCrvs, compassCrvs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; plug-in component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
toggle = BooleanToggle(False)
panel_10 = Panel("C:\Users\Zghiru\Documents\GitHub\RC_BuildingSimulator\rc_simulator\grasshopper_component\tests\grasshopper_attributes.csv")
panel_11 = Panel("C:\Users\Zghiru\Documents\GitHub\RC_BuildingSimulator\rc_simulator\grasshopper_component\tests\grasshopper_result.csv")
python = PythonScript(results=simulate_period.local_and_global_variables, fileAddress=panel_10, export=toggle)  # -> out, a; inputs results: list
# ---------- python: Python ----------
import Rhino as rc

if export:
    fileName = open(fileAddress,'w+')
    for line in results:
        fileName.write(line + '\n')
    fileName.close()
# ---------- end python ----------
# y-axis ticks (in progress)
panel_12 = Panel("0")
eval = Evaluate(F="(y-x)/z+1", x=panel_12, y="30", z="5")
graph_gridlines = PythonScript(start=panel_12, end="30", y_interval="5", x_length=number_of_hours)  # -> out, a; inputs x_length: Int32
# ---------- graph_gridlines: Python ----------
"""
This funtion creates a series of lists which can be used 

list_to_tree was taken from https://gist.github.com/piac/ef91ac83cb5ee92a1294
"""
domain = end - start

def list_to_tree(input, none_and_holes=True, source=[0]):
    """Transforms nestings of lists or tuples to a Grasshopper DataTree"""
    from Grasshopper import DataTree as Tree
    from Grasshopper.Kernel.Data import GH_Path as Path
    from System import Array
    def proc(input,tree,track):
        path = Path(Array[int](track))
        if len(input) == 0 and none_and_holes: tree.EnsurePath(path); return
        for i,item in enumerate(input):
            if hasattr(item, '__iter__'): #if list or tuple
                track.append(i); proc(item,tree,track); track.pop()
            else:
                if none_and_holes: tree.Insert(item,path,i)
                elif item is not None: tree.Add(item,path)
#if input is not None: t=Tree[object]();proc(input,t,source[:]);return t

# create a list of the desired ticks
y_ticks = []
number_of_ticks = int(domain//y_interval)
for ii in range(0,number_of_ticks):
    y_ticks.append(start+ii*y_interval)

# create a list of lists, with each sublist having length x_length
tick_list = []
for tick in y_ticks:
    tick_list.append([tick]*x_length)

a = list_to_tree(tick_list,True,[0])
# ---------- end graph_gridlines ----------
series = Series(Start=panel_12, Step="5", Count=eval)
dup = DuplicateData(Data=graft(series), Number=number_of_hours, Order=True)
panel_13 = Panel(graph_gridlines.out)

# ---- group: Hacky grasshopper way to read schedule from csv
occupancy_schedules_csv = Panel("C:\Users\Zghiru\Documents\GitHub\RC_BuildingSimulator\rc_simulator\grasshopper_component\occupancy_schedules.csv")
file = ReadFile(File=occupancy_schedules_csv, PerLineParse=True)
list = ValueList({"Multi Residential": 0, "Single Residential": 1, "Hotel": 2, "Office": 3, "Retail": 4, "Foodstore": 5, "Restaurant": 6, "Industrial": 7, "School": 8, "Hospital": 9, "Gym": 10}, selected="Office")
split = TextSplit(Text=file, Separators=",")  # -> simplify(Result)
item_2 = ListItem(List=split, Index=list, Wrap=True)  # -> flatten(Item)
cull_i_2 = CullIndex(List=item_2, Indices=0, Wrap=True)

# ---- group: sets time steps for simulation
# RC building simulation
hour_to_simulate = Slider(0, range=0..138)
doy_hoy = Ladybug_DOY_HOY(days=start_day, months=start_month, hours=1)  # -> HOY, DOY, date; plug-in component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
series_2 = Series(Start=0, Step=1, Count=number_of_hours)
fly = Ladybug_fly(inputSliders=hour_to_simulate, fly=run_radiation)  # -> Vviiiiiiiiiizzz; plug-in component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
c_script = CSharpScript(name="hour_to_simulate", min=0, max=number_of_hours, decimals=0)  # -> out, A; inputs name: String, min: Double, max: Double, decimals: Int32
# ---------- c_script: C# ----------
    foreach (IGH_DocumentObject obj in owner.OnPingDocument().Objects )
    {
      Grasshopper.Kernel.Special.GH_NumberSlider slider = obj as Grasshopper.Kernel.Special.GH_NumberSlider;
      if (slider == null) { continue; }
      if (slider.NickName.Equals(name, StringComparison.OrdinalIgnoreCase))
      {
        double norm = slider.Slider.NormalizedValue;

        slider.Slider.Minimum = (decimal) min;
        slider.Slider.Maximum = (decimal) max;
        if (decimals <= 0)
        {
          slider.Slider.Type = Grasshopper.GUI.Base.GH_SliderAccuracy.Integer;
        }
        else
        {
          slider.Slider.Type = Grasshopper.GUI.Base.GH_SliderAccuracy.Float;
          slider.Slider.DecimalPlaces = decimals;
        }

        //Must disable events since we are modifying this thing during a solution.
        //This is actually illegal.
        slider.Slider.RaiseEvents = false;
        slider.Slider.NormalizedValue = norm;
        slider.Slider.RaiseEvents = true;
      }
    }
# ---------- c_script: C# additional code ----------
///Taken from: http://www.grasshopper3d.com/forum/topics/change-number-slider-parameter-using-python
# ---------- end c_script ----------

# ----
addition = Addition(A=doy_hoy.HOY, B=series_2)
int = Integer(addition)

# ---- group: sets time steps for simulation (continued)
item_3 = ListItem(List=int, Index=hour_to_simulate, Wrap=True)

# ---- group: simulate radiation
selectskymtx = Ladybug_selectSkyMtx(cumulativeSkyMtx=gencumulativeskymtx.cumulativeSkyMtx, HOY=item_3, removeDiffuse=False, removeDirect=False)  # -> readMe, selectedSkyMtx; plug-in component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
radiationanalysis = Ladybug_RadiationAnalysis(
    geometry=flatten(walls_2),
    gridSize="1",
    disFromBase=".1",
    selectedSkyMtx=flatten(selectskymtx.selectedSkyMtx),
    legendPar=flatten(legendpar),
    runIt=Toggle(True))  # -> readMe, contextMesh, analysisMesh, testPts, testVec, port, radiationResult, radiationMesh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; plug-in component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
multiplication = Multiplication(A=radiationanalysis.totalRadiation, B=1000)
variable_recorder = PythonScript(x=multiplication, array_length=number_of_hours)  # -> out, recorded_result; inputs array_length: Int32
# ---------- variable_recorder: Python ----------
"""
Data recorder with variable output length.

#TODO: reset recL every time array_length is changed.
"""
if 'recL' in locals() and array_length!=None:
        recL.append(x)
else:
    recL = []

recorded_result = recL[len(recL)-array_length:]
# ---------- end variable_recorder ----------

# ---- group: Temperatures
strnum_3 = Ladybug_SeparateData(inputList=flatten(importepw.dryBulbTemperature))  # -> numbers, strings; plug-in component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
item_4 = ListItem(List=strnum_3.numbers, Index=int, Wrap=True)  # -> simplify(Item)

# ---- group: Hacky grasshopper way to read schedule from csv (continued)
item_5 = ListItem(List=cull_i_2, Index=int, Wrap=True)

# ---- group: Make sure the inputs for internal gains, occupancy and occupancy come out in the right format
multiplication_2 = Multiplication(A=panel, B="7")
python_2 = PythonScript(area=multiplication_2, max_occupancy="3", occupancy_per_m2=item_5)  # -> out, occupancy, internal_gains; inputs occupancy_per_m2: list
# ---------- python_2: Python ----------
# This doesn't make sense yet 
#The units for rate should be 
# occupancy = rate * number of occupants * area

gains_per_person = 100 #W
appliance_gains = 14  # W per sqm

occupancy = list(map(lambda x:max_occupancy*x, occupancy_per_m2))

internal_gains = list(map(lambda x: gains_per_person*x + area*appliance_gains, occupancy))
# ---------- end python_2 ----------

# ----
pt = Point(radiationanalysis.testPts)
panel_14 = Panel(variable_recorder.recorded_result)
ins = InsertItems(List=int, Item=title_5, Indices=0, Wrap=True)  # -> graft(List)
ins_2 = InsertItems(List=python_2.internal_gains, Item=title_11, Indices=0, Wrap=True)  # -> graft(List)
ins_3 = InsertItems(List=int, Item=title_10, Indices=0, Wrap=True)  # -> graft(List)
ins_4 = InsertItems(List=item_4, Item=title_2, Indices=0, Wrap=True)  # -> graft(List)
ins_5 = InsertItems(List=int, Item=title_10, Indices=0, Wrap=True)  # -> graft(List)
ins_6 = InsertItems(List=python_2.occupancy, Item=title_3, Indices=0, Wrap=True)  # -> graft(List)
day_month_hour_calculator = Ladybug_Day_Month_Hour(HOY=int)  # -> day, month, hour, date; plug-in component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
ins_7 = InsertItems(List=python_2.internal_gains, Item=radiation_3, Indices=0, Wrap=True)  # -> graft(List)
ins_8 = InsertItems(List=variable_recorder.recorded_result, Item=radiation_2, Indices=0, Wrap=True)  # -> graft(List)
ins_9 = InsertItems(List=day_month_hour_calculator.date, Item=radiation, Indices=0, Wrap=True)  # -> graft(List)

# ---- group: simulate period
# Simulate Period
simulate_period_2 = ASRCBuildingSimulator(
    outdoor_air_temperature=item_4,
    internal_gains=python_2.internal_gains,
    solar_irradiation=variable_recorder.recorded_result,
    occupancy=python_2.occupancy,
    Zone=simulate_period.Zone)  # -> out, indoor_air_temperature, mass_temperature, lighting_demand, heating_demand, cooling_demand, energy_demand, solar_gains, ill; inputs outdoor_air_temperature: list, previous_mass_temperature: list, internal_gains: list, solar_irradiation: list, occupancy: list
# ---------- simulate_period_2: Python ----------
""" Not sure exactly but I think this should go here...
ghenv.Component.Name = "AS_simulate_period"
ghenv.Component.NickName = 'sim_period'
ghenv.Component.Message = 'VER 0.0.1'
ghenv.Component.IconDisplayMode = ghenv.Component.IconDisplayMode.application
#ghenv.Component.Category = "Ladybug"
#ghenv.Component.SubCategory = "3 | EnvironmentalAnalysis"
"""

import Grasshopper.Kernel as gh
import scriptcontext

hours = len(outdoor_air_temperature)

#Initialise zone object
if Zone == None:
    Zone = scriptcontext.sticky["RC_Zone"]()
    warning = """No zone definition has been detected. The default zone will be
    applied."""
    w = gh.GH_RuntimeMessageLevel.Warning
    ghenv.Component.AddRuntimeMessage(w, warning)
else:
    Zone = Zone

# Initialise simulation parameters
# TODO: Check that all inputs are of the same length
if outdoor_air_temperature == []:
    t_air = [20]*hours
else:
    t_air = outdoor_air_temperature

if previous_mass_temperature == []:
    t_m_prev = 20
else:
    t_m_prev = previous_mass_temperature

if internal_gains == []:
    internal_gains = [10]*hours  # Watts

if solar_irradiation == []:
    solar_irradiation = [2000]*hours # Watts. Requires adjustment to account for window losses

solar_gains = [x * g_windows for x in solar_irradiation]

#Spectral luminous efficacy (108)- can be calculated from the weather file https://en.wikipedia.org/wiki/Luminous_efficacy
ill = [s * 108 for s in solar_irradiation]

if occupancy == []:
    occupancy = [0.1]*hours  # Occupancy for the timestep [people/hour/square_meter]

"""
#  Export obect attributes for testing and debugging
attrs = vars(Zone)
for item in attrs.items():
    local_and_global_variables.append("%s: %s" % item)
"""

#Initialise result lists
indoor_air_temperature = []
mass_temperature = []
energy_demand = []
heating_demand = []
cooling_demand = []
lighting_demand = []

#Start simulation
for hour in range(0,hours):
    il = ill[hour]
    ig = internal_gains[hour]
    ta = t_air[hour]
    sg = solar_gains[hour]
    oc = occupancy[hour]

    #Solve
    Zone.solve_building_energy(ig, sg, ta, t_m_prev)    
    Zone.solve_building_lighting(il, oc)
    
    #Set T_m as t_m_prev for next timestep
    t_m_prev = Zone.t_m

    #Record Results
    indoor_air_temperature.append(Zone.t_air)
    mass_temperature.append(Zone.t_m)  # Printing Room Temperature of the medium
    lighting_demand.append(Zone.lighting_demand)  # Print Lighting Demand
    energy_demand.append(Zone.energy_demand)  # Print heating/cooling loads
    heating_demand.append(Zone.heating_demand)
    cooling_demand.append(Zone.cooling_demand)
# ---------- end simulate_period_2 ----------
outdoor_temperature = Panel(item_4)
cooling_demand_w = Panel(simulate_period_2.cooling_demand)
heating_demand_w = Panel(simulate_period_2.heating_demand)
indoor_temperature = Panel(simulate_period_2.indoor_air_temperature)
lighting_demand_w = Panel(simulate_period_2.lighting_demand)

# ----
ins_10 = InsertItems(List=simulate_period_2.cooling_demand, Item=title_8, Indices=0, Wrap=True)  # -> graft(List)
ins_11 = InsertItems(List=simulate_period_2.heating_demand, Item=title_7, Indices=0, Wrap=True)  # -> graft(List)
ins_12 = InsertItems(List=simulate_period_2.lighting_demand, Item=title_9, Indices=0, Wrap=True)  # -> graft(List)
ins_13 = InsertItems(List=simulate_period_2.solar_gains, Item=title_6, Indices=0, Wrap=True)  # -> graft(List)
ins_14 = InsertItems(List=simulate_period_2.indoor_air_temperature, Item=title, Indices=0, Wrap=True)  # -> graft(List)
ins_15 = InsertItems(List=simulate_period_2.ill, Item=title_4, Indices=0, Wrap=True)  # -> graft(List)
merge = Merge(
    Data1=simplify(ins),
    Data2=simplify(ins_13),
    Data3=simplify(ins_11),
    Data4=simplify(ins_10),
    Data5=simplify(ins_12),
    Data6=simplify(ins_2))  # disabled
merge_2 = Merge(Data1=simplify(ins_3), Data2=simplify(ins_4), Data3=simplify(ins_14))  # disabled
merge_3 = Merge(Data1=simplify(ins_5), Data2=simplify(ins_15), Data3=simplify(ins_6))  # disabled
join_2 = TextJoin(Text=merge, Join=",")  # -> flatten(Result); disabled
join_3 = TextJoin(Text=merge_2, Join=",")  # -> flatten(Result); disabled
join_4 = TextJoin(Text=merge_3, Join=",")  # -> flatten(Result); disabled
python_3 = PythonScript(results=join_2, fileAddress=panel_3, export=toggle)  # -> out, a; inputs results: list; disabled
# ---------- python_3: Python ----------
import Rhino as rc

if export:
    fileName = open(fileAddress,'w')
    for line in results:
        fileName.write(line + '\n')
    fileName.close()
# ---------- end python_3 ----------
python_4 = PythonScript(results=join_3, fileAddress=panel_4, export=toggle)  # -> out, a; inputs results: list; disabled; same code as python_3
python_5 = PythonScript(results=join_4, fileAddress=panel_5, export=toggle)  # -> out, a; inputs results: list; disabled; same code as python_3
merge_4 = Merge(Data1=simplify(ins_9), Data2=simplify(ins_8), Data3=simplify(ins_7))
join_5 = TextJoin(Text=merge_4, Join=",")  # -> flatten(Result)
merge_5 = Merge(
    Data1=simplify(ins),
    Data2=simplify(ins_13),
    Data3=simplify(ins_11),
    Data4=simplify(ins_10),
    Data5=simplify(ins_12),
    Data6=simplify(ins_2),
    Data7=simplify(ins_3),
    Data8=simplify(ins_4),
    Data9=simplify(ins_14),
    Data10=simplify(ins_5),
    Data11=simplify(ins_15),
    Data12=simplify(ins_6))
inputs = Panel(join_5)

# ---- group: DNI
strnum_4 = Ladybug_SeparateData(inputList=flatten(importepw.directNormalRadiation))  # -> numbers, strings; plug-in component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
item_6 = ListItem(List=strnum_4.numbers, Index=int, Wrap=True)  # -> simplify(Item)

# ----
join_6 = TextJoin(Text=merge_5, Join=",")  # -> flatten(Result)
python_6 = PythonScript(results=join_6, fileAddress=panel_11, export=toggle)  # -> out, a; inputs results: list; same code as python
energy = QuickGraph(item_6)
mass_temperature = Panel(simulate_period_2.mass_temperature)
occupancy = QuickGraph(python_2.occupancy)

# ---- group: Temperature
graph = QuickGraph([outdoor_temperature, indoor_temperature, mass_temperature, dup])

# ----
energy_2 = QuickGraph([simulate_period_2.solar_gains, python_2.internal_gains, lighting_demand_w, heating_demand_w, cooling_demand_w])

# ==== cluster Cluster
L = ClusterInput()
lng = ListLength(List=L)
G = ClusterInput()
series = Series(Start=0, Step=1, Count=lng)
area = Area(Geometry=G)  # -> Area, Centroid
int = Integer(series)
orient2camera = Ladybug_OrientToCamera(initPosition=area.Centroid)  # -> orientedToCam; plug-in component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
int_2 = ClusterOutput(int)
timer = Timer(TimerInterval=1000, Target=orient2camera)
orientedtocam = ClusterOutput(orient2camera)
